# Grasshopper definition base_element.gh (Grasshopper 1.0.7)

box = Box({Plane=PlaneXY(7.560648238, -4.966559617, 0), X=Domain(0, 2.720429604), Y=Domain(0, 3.996752162), Z=Domain(0, 2.159396973)})
end = Box({Plane=PlaneXY(7.560648238, 3.026944706, 0), X=Domain(0, 2.720429604), Y=Domain(0, 3.996752162), Z=Domain(0, 2.159396973)})
debrep = DeconstructBrep(Brep=box)  # -> Faces, Edges, Vertices
mid = Box({Plane=Plane(origin=(7.560648238, -0.9698074559, 0), x=(0, 1, 0), y=(1, 0, 0)), X=Domain(0, 3.996752162), Y=Domain(0, 2.720429604), Z=Domain(-2.159396973, 0)})
item = ListItem(List=debrep.Faces, Index="2", Wrap=True)
edges = BrepEdges(Brep=mid)  # -> Naked, Interior, NonManifold
debrep_2 = DeconstructBrep(Brep=mid)  # -> Faces, Edges, Vertices
number_slider = Slider(1.7, range=0..10)
item_2 = ListItem(List=debrep_2.Vertices, Index="0", Wrap=True)
item_3 = ListItem(List=debrep_2.Vertices, Index="1", Wrap=True)
item_4 = ListItem(List=debrep_2.Vertices, Index="4", Wrap=True)
addition = Addition()
Z = UnitZ(Factor=number_slider)
item_5 = ListItem(List=debrep_2.Vertices, Index="1", Wrap=True)
move = Move(Geometry=item_3, Motion=Z)  # -> Geometry, Transform
vec2pt = Vector2Pt(PointA=item_2, PointB=move.Geometry, Unitize=False)  # -> Vector, Length
move_2 = Move(Geometry=end, Motion=Z)  # -> Geometry, Transform
extr = Extrude(Base=item, Direction=vec2pt.Vector)
Z_2 = UnitZ(Factor=number_slider)
move_3 = Move(Geometry=item_5, Motion=Z_2)  # -> Geometry, Transform
