# Grasshopper definition base_element_0_1_0_deformation_trials.gh (Grasshopper 1.0.7)
# plug-ins: LunchBox, Weaverbird

end = Box({Plane=PlaneXY(7.560648238, 3.026944706, 0), X=Domain(0, 2.720429604), Y=Domain(0, 3.996752162), Z=Domain(0, 2.159396973)})
box = Box({Plane=PlaneXY(7.560648238, -4.966559617, 0), X=Domain(0, 2.720429604), Y=Domain(0, 3.996752162), Z=Domain(0, 2.159396973)})
srf = Surface(<surface referenced from the Rhino model>)
dim = Dimensions(Surface=srf)  # -> UDimension, VDimension
debrep = DeconstructBrep(Brep=box)  # -> Faces, Edges, Vertices
dom²num = ConstructDomain²(UMin=0, UMax=dim.UDimension, VMin=0, VMax=dim.VDimension)
sbox = SurfaceBox(Surface=srf, Domain=dom²num, Height=Slider(12, range=0..100))
mid = Box({Plane=Plane(origin=(7.560648238, -0.9698074559, 0), x=(0, 1, 0), y=(1, 0, 0)), X=Domain(0, 3.996752162), Y=Domain(0, 2.720429604), Z=Domain(-2.159396973, 0)})

# ---- group: Box By Deform
box_2 = Box({Plane=PlaneXY(-61.07125923, 69.82149661, 0), X=Domain(0, 12.38708913), Y=Domain(0, 13.16851888), Z=Domain(0, 8.00031301)})
volume = Volume(Geometry=box_2)  # -> Volume, Centroid
debrep_2 = DeconstructBrep(Brep=box_2)  # -> Faces, Edges, Vertices
vec2pt = Vector2Pt(PointA=volume.Centroid, PointB=debrep_2.Vertices, Unitize=False)  # -> Vector, Length
deform = SpatialDeform(Geometry=box_2, Syntax=debrep_2.Vertices, Forces=vec2pt.Vector)

# ----
box_3 = Box({Plane=PlaneXY(-4.679931778, 109.2229372, 0), X=Domain(0, 7.211524926), Y=Domain(0, 8.440403513), Z=Domain(0, 4.56280675)})
item = ListItem(List=debrep.Faces, Index="2", Wrap=True)

# ---- group: Twisted Connector Box
srf_2 = Surface(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)
srf_3 = Surface(<surface referenced from the Rhino model>)
dim_2 = Dimensions(Surface=srf_2)  # -> UDimension, VDimension
dim_3 = Dimensions(Surface=srf_3)  # -> UDimension, VDimension
dom²num_2 = ConstructDomain²(UMin=0, UMax=dim_3.UDimension, VMin=0, VMax=dim_3.VDimension)
dom²num_3 = ConstructDomain²(UMin=0, UMax=dim_2.UDimension, VMin=0, VMax=dim_2.VDimension)
blendbox = BlendBox(SurfaceA=srf_2, DomainA=dom²num_3, SurfaceB=srf_3, DomainB=dom²num_2)

# ----
md_slider = MDSlider(
    SliderMode=0,
    slider_value=Point(0.44261095, 0.1915350193, 0.5),
    x_domain=Domain(0, 1),
    y_domain=Domain(0, 1),
    z_domain=Domain(0, 1))
volume_2 = Volume(Geometry=box_3)  # -> Volume, Centroid
debrep_3 = DeconstructBrep(Brep=box_3)  # -> Faces, Edges, Vertices
debrep_4 = DeconstructBrep(Brep=mid)  # -> Faces, Edges, Vertices
number_slider = Slider(2.04, range=0..10)
vec2pt_2 = Vector2Pt(PointA=volume_2.Centroid, PointB=debrep_3.Vertices, Unitize=False)  # -> Vector, Length
item_2 = ListItem(List=debrep_4.Vertices, Index="0", Wrap=True)
item_3 = ListItem(List=debrep_4.Vertices, Index="1", Wrap=True)
item_4 = ListItem(List=debrep_4.Vertices, Index="4", Wrap=True)
devec = DeconstructVector(Vector=md_slider)  # -> XComponent, YComponent, ZComponent
pdeform = PointDeform(Geometry=box_3, Points=debrep_3.Vertices, Motion=vec2pt_2.Vector)
X = UnitX(Factor=devec.XComponent)
Z = UnitZ(Factor=devec.YComponent)
vec = VectorXYZ(XComponent=0, YComponent=0, ZComponent=0)  # -> Vector, Length
addition = Addition(A=X, B=Z)
move = Move(Geometry=item_3, Motion=addition)  # -> Geometry, Transform
vec2pt_3 = Vector2Pt(PointA=item_2, PointB=move.Geometry, Unitize=False)  # -> Vector, Length
start = Box(box)

# ---- group: Extra Morphing
number_slider_2 = Slider(9, range=0..10)
mesh = Mesh(deform)
wbtile = WeaverbirdsTile(MeshCurves=mesh, FillStrategy=1, OptIn=2)
wbblur = WeaverbirdsBlurMesh(MeshCurves=mesh, Level=number_slider_2, Thin=1)
wblaplace = WeaverbirdsLaplacianSmoothing(MeshCurves=mesh, Level=number_slider_2, SmoothNakedEdges="2", Thin=1)

# ----
extr = Extrude(Base=item, Direction=vec2pt_3.Vector)
move_2 = Move(Geometry=end, Motion=addition)  # -> Geometry, Transform
wbweave = WeaverbirdsMeshFromLinesWeaveBack(MaximumValence=4)
morph = BoxMorph()
wbtile_2 = WeaverbirdsTile(FillStrategy=1, OptIn=2)
join = BrepJoin(Breps=flatten([start, extr, move_2.Geometry]))  # -> Breps, Closed
bake = ObjectBake(
    BakeToggle=Button(),
    GeometryObjects=join.Breps,
    Layer="GH_Bake",
    ObjectName="GH_Obj",
    ObjectColor=RGB(255, 255, 255),
    LayerColor=RGB(255, 255, 255))
